# Dynamo graph 00 Auto Numbering Conduits.dyn (Dynamo 1.3.4.6666)

# group: Selection
boolean = BoolSelector(false)
currentSelection = Custom[Springs.Collector.CurrentSelection](refresh=boolean)  # Gets the currently selected elements. Connect a boolean switch to refresh the selection.
getRevitSelection = Custom[Tool.GetRevitSelection](reset=boolean)  # Get the selection from the Revit UI, use boolean action to refresh when selection must be updated

all_elements_in_active_view = ElementsInView()

# group: Conduit Size
string = StringInput("eVolve_Description")
getParameterValueByName = Element.GetParameterValueByName(element=all_elements_in_active_view, parameterName=string)

# group: Length
string_2 = StringInput("eVolve_Length")
getParameterValueByName_2 = Element.GetParameterValueByName(element=all_elements_in_active_view, parameterName=string_2)

code_block = CodeBlock { 0.005; }
round = Custom[Math.Round+](dbl=getParameterValueByName_2, precision=code_block)  # Rounds a number to a specified precision
code_block_2 = CodeBlock(dia=getParameterValueByName, length=round) { dia+length; }
sortByKey = List.SortByKey(list=all_elements_in_active_view, keys=code_block_2)
watch = Watch(sortByKey.sorted_keys)
groupByKey = List.GroupByKey(list=sortByKey.sorted_list, keys=watch)
watch_2 = Watch(groupByKey.groups)
string_3 = StringInput("Mark")
getKeys = GetKeys(groupByKey.unique_keys)
string_from_object = FromObject(getKeys)
toNumber = String.ToNumber(string_from_object)
conduit_starting_number = DoubleInput(9)
code_block_3 = CodeBlock { 1; }
sub = conduit_starting_number - code_block_3
add = toNumber + sub
string_from_object_2 = FromObject(add)
setParameterByName = Element.SetParameterByName(element=watch_2, parameterName=string_3, value=string_from_object_2)
watch_3 = Watch(sortByKey.sorted_list)
watch_4 = Watch(groupByKey.unique_keys)
elementsInView = Custom[Springs.Collector.ElementsInView]()  # Selects all elements visible in the input view.; unwired: view
